# Grasshopper definition BiegemaschineSD.gh (Grasshopper 1.0.7)
# plug-ins: Squid (ShapeDiver Edition), ShapeDiver

spannlänge = Slider(0, range=0..100)
import_dxf = ShapeDiverGeometryInput(
    maximum_file_size=10485760,
    selected_file_formats="application/dxf,application/wavefront-obj,application/x-autocad,application/x-dxf,drawing/x-dxf,image/vnd.dxf,image/x-autocad,image/x-dxf,zz-application/zz-winassoc-dxf")  # -> Object, Material
crv = Curve(import_dxf.Object)
pipe_diameter = Slider(21, range=0..40)
closed_loop = BooleanToggle(False)
multiplication = Multiplication(A=pipe_diameter, B=1.5)
division = Division(A=pipe_diameter, B=2)
pt = ConstructPoint(XCoordinate="0", YCoordinate="0", ZCoordinate="0")
sdsimplematerial = ShapeDiverSimpleMaterial(Color=RGB(255, 255, 255), MaterialIndex=1)
vec = VectorXYZ(XComponent="0", YComponent="0", ZComponent="0")  # -> Vector, Length
todo = Panel("""ANfangslänge
Shift path""")
email_address = ShapeDiverTextInput(maxlength=100, text="Default")
units = ValueList({"Meter": 100, "Centimeter": 10, "Milllimeter": 1}, selected="Centimeter")
scale = Scale(Geometry=crv, Center=Point(0, 0, 0), Factor=units)  # -> Geometry, Transform
explode = Explode(Curve=scale.Geometry, Recursive=True)  # -> Segments, Vertices
lng = ListLength(List=explode.Segments)
subtraction = Subtraction(A=lng, B=1)
item = ListItem(List=explode.Segments, Index=subtraction, Wrap="false")
len = Length(Curve=item)
subtraction_2 = Subtraction(A="445", B=len)
addition = Addition(A=subtraction_2, B=10)
ext = ExtendCurve(Curve=scale.Geometry, Type=0, Start=spannlänge, End=addition)
explode_2 = Explode(Curve=ext, Recursive=True)  # -> Segments, Vertices
item_2 = ListItem(List=explode_2.Segments, Index=subtraction, Wrap=True)
len_2 = Length(Curve=item_2)
fillet = Fillet(Curve=ext, Radius=multiplication)
explode_3 = Explode(Curve=fillet, Recursive=True)  # -> Segments, Vertices
lng_2 = ListLength(List=explode_2.Vertices)
subtraction_3 = Subtraction(A=lng_2, B=2)
cull_i = CullIndex(List=explode_2.Vertices, Indices=subtraction_3, Wrap=True)
item_3 = ListItem(List=cull_i, Index=0, Wrap=True)
rectangle = Rectangle(Plane=item_3, XSize=Domain(-1, 1), YSize=Domain(-2, 2), Radius=0)  # -> Rectangle, Length
vec2pt = Vector2Pt(PointA=item_3, PointB=pt, Unitize=False)  # -> Vector, Length
text = Text(Rectangle=rectangle.Rectangle, Text="Hello world!", Color=RGB(0, 0, 0))
pipe = Pipe(Curve=explode_3.Segments, Radius=division, Caps=0)
move = Move(Geometry=cull_i, Motion=vec2pt.Vector)  # -> Geometry, Transform
squid = Squid(BitmapR={Plane=PlaneXY(0, 0, 0), Size=Domain2(u=0..500, v=0..300)}, SquidInstr=text, PPU=1, AA=True, autohide=False)
shift = ShiftList(List=move.Geometry, Shift=1, Wrap=closed_loop)
sddisplaygeometry = ShapeDiverDisplayGeometry(Geometry=pipe, ShapeDiverMaterial=sdsimplematerial)
vec2pt_2 = Vector2Pt(PointA=move.Geometry, PointB=shift, Unitize=False)  # -> Vector, Length
ins = InsertItems(List=vec2pt_2.Vector, Item=vec.Vector, Indices="0", Wrap=True)
cull_i_2 = CullIndex(List=ins, Indices="0", Wrap=True)
lng_3 = ListLength(List=cull_i)
addition_2 = Addition(A=lng_3, B=1)
culln = CullNth(List=cull_i_2, CullFrequency=lng_3)
devec = DeconstructVector(Vector=culln)  # -> XComponent, YComponent, ZComponent
subtraction_4 = Subtraction(A=lng_3, B=1)
round = Round(Number=devec.YComponent)  # -> Nearest, Floor, Ceiling
round_2 = Round(Number=devec.XComponent)  # -> Nearest, Floor, Ceiling
round_3 = Round(Number=devec.ZComponent)  # -> Nearest, Floor, Ceiling
series = Series(Start="1", Step=1, Count=subtraction_4)
concat = Concatenate(FragmentB=round_2.Nearest, FragmentC=",")
concat_2 = Concatenate(FragmentB=round.Nearest, FragmentC=",")
concat_3 = Concatenate(FragmentB=round_3.Nearest)
concat_4 = Concatenate(FragmentB=series, FragmentC=",")
concat_5 = Concatenate(FragmentD=concat_4, FragmentA=concat, FragmentB=concat_2, FragmentC=concat_3)
ins_2 = InsertItems(List=concat_5, Item=" ,X,Y,Z", Indices="0", Wrap=True)
panel = Panel(ins_2)
am_ende_abschneide = Panel(addition)
concat_6 = Concatenate(FragmentA="Am Ende abschneiden:", FragmentB=addition, FragmentC="Spenden über Paypal: mail@philippenzmann.com")
send_mail = ShapeDiverExportEmail(
    Geometry=panel,
    Format="csv",
    Name="Tabelle zum Biegen",
    Email=email_address,
    Subject="Deine Biegetabelle!",
    Body=concat_6)
